# Grasshopper definition 4_AnnualWindAnalysis.ghx (Grasshopper 1.0.7)
# plug-ins: VirtualWindTunnel

# C:\Users\pkastner\Google Drive\Patrick\Papers\CPGenerator\Conference\Data\Weather\AUS_NT.Tennant.Creek.942380_RMY.epw
panel = Panel("C:\Users\pkastner\Google Drive\Patrick\Papers\CPGenerator\Conference\Data\Weather\AUS_NSW.Dubbo.Airport.957190_RMY.epw")

# ----
# 1. Geometry &
# Boundary Conditions
# C:\DIVA\WeatherData\USA_IL_Chicago-OHare.Intl.AP.725300_TMY3.epw
panel_2 = Panel("""0
45
90
135
180
225
270
315""")
abl = ABL(WDir=panel_2, Uref="10", Zref=10, Z0=1, ZGround=0, Epw=panel)
geo = Geometry([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])

# ----
# 2. Simulation Domain
number_slider = Slider(50, range=0..1000)
domaincyl = CylindricalDomain(
    Geometry=geo,
    BCond=abl,
    BlockSize="10",
    SizeOfInnerRectangle=number_slider,
    SizeOfOuterRadius=Slider(300, range=0..1000),
    Height=Slider(80, range=0..1000))  # -> Domain, Mesh

# ----
# 3. Mesh & Simulation
panel_3 = Panel("3")
mset = MeshSettings(AccBuilding=2, AccFeatures=panel_3, AccRefinement=0, AccGround=2, NLayer=3, Mode=1)
rset = RunSettings(
    Iterations="100",
    WriteInterval=20,
    KeepTimeSteps=2,
    Turbulence=1,
    RelaxationFactors=0,
    Mode=0,
    CPUs="3",
    OperationSystem=0)
simulation = Simulation(
    SimulationDomain=domaincyl.Domain,
    WorkingDirectory="C:\test_cyl",
    MeshSettings=mset,
    RunSettings=rset,
    RunMeshing=Button(),
    RunSimulation=Button(),
    runWithBlueCFD=True)

residuals = Residuals(Result=simulation, SelectionOfWindDirections="0", X=":", Y=":", Version=0, Run=Button(), visResiduals=True)

# ----
# 4. Probing points & probing
number_slider_2 = Slider(6, range=1..50)
brep = Brep(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)
meshplane = MeshPlane(brep=brep, number=number_slider_2)  # -> vertices, faces
visprobes = VisualizeProbes(Result=simulation, ProbingPoints=meshplane.vertices, NameOfInstance="cyl", NameOfField=0, Run=Button(), Culling=True)  # -> PorbingPoints, ProbingResult

# ----
# 6. Clean
button = Button()
clean = Clean(Directory=simulation, Mode=2, Run=button)

windfactors = WindFactors(Interpolation=True)  # -> WindFactors, LawsonPedestrianComfort, DavenportPedestrianComfort

# ----
# 5. Post-processing
# 5.1. Paraview
# Multi-directional / annual wind vectors
# 5.2. Grasshopper
# 5.3. Grasshopper
# Pedestrian wind comfort
button_2 = Button()
dir = Slider(0, range=0..7)
button_3 = Button()
points = Data(visprobes.PorbingPoints)
vectors = Data(visprobes.ProbingResult)
paraview = Paraview(Result=simulation, ParaviewVersion=1, Run=button_2)
choose_dir = TreeBranch(Tree=vectors, Path=dir, MaintainPaths=True)
windfactors_2 = WindFactors(Run=button_3, Interpolation=True)  # -> WindFactors, PedestrianComfort, OffSet
cluster = Cluster(data=choose_dir)  # -> S, E, data_3
gradient = Gradient(
    LowerLimit=cluster.S,
    UpperLimit=Slider(8, range=0..10),
    Parameter=cluster.data_3,
    stops=[0.103: RGB(0, 0, 255), 0.22: RGB(0, 170, 255), 0.305: RGB(0, 255, 255), 0.398: RGB(0, 255, 188), 0.504: RGB(0, 255, 106), 0.605: RGB(91, 255, 0), 0.699: RGB(184, 255, 0), 0.799: RGB(255, 255, 0), 0.898: RGB(255, 170, 0)])
dedata = DeconstructData(Data=windfactors.WindFactors)  # disabled
flip = FlipMatrix(Data=dedata)
avr = Average(Input=flip)  # -> flatten(ArithmeticMean)
vdisex = VectorDisplayEx(Point=points, Vector=choose_dir, Colour=gradient, Width=Slider(3, range=0..10))
cluster_2 = Cluster()  # -> S, E, data_3
gradient_2 = Gradient(
    LowerLimit=cluster_2.S,
    UpperLimit=cluster_2.E,
    Parameter=cluster_2.data_3,
    stops=[0.103: RGB(0, 0, 255), 0.22: RGB(0, 170, 255), 0.305: RGB(0, 255, 255), 0.398: RGB(0, 255, 188), 0.504: RGB(0, 255, 106), 0.605: RGB(91, 255, 0), 0.699: RGB(184, 255, 0), 0.799: RGB(255, 255, 0), 0.898: RGB(255, 170, 0)])
cluster_3 = Cluster_2(C=points)
preview = CustomPreview(Geometry=cluster_3, Material=gradient_2)

windfactors_3 = WindFactors(Interpolation=True)  # -> WindFactors, LawsonPedestrianComfort, DavenportPedestrianComfort
windfactors_4 = WindFactors(Result=simulation, ProbingPoints=points, U=vectors, Run=button_3, Interpolation=True)  # -> WindFactors, LawsonPedestrianComfort, DavenportPedestrianComfort
c_script = CSharpScript(x=windfactors_4.WindFactors, Reference="C:\Users\pkastner\Documents\GitHub\Eddy3d\Build\Build.Ilmerge\EddyLib.dll")  # -> out, A
# ---------- c_script: C# usings ----------
using EddyLib;
using System.Linq;
# ---------- c_script: C# ----------
    var xx = (EddyLib.WindFactors) x;
    A = CalcNEN8100Comfort(xx.ValuesWindFactors);
# ---------- c_script: C# additional code ----------
  private double[] CalcNEN8100Comfort(double[,] ValuesWindFactors)
  {
    int sensorPointCount = ValuesWindFactors.GetLength(1);
    var pedestrianComfort = new double[sensorPointCount];

    for (int probe = 0; probe < sensorPointCount; probe++)
    {
      // column is all hours of the year
      var column = ArrayHelper.CustomArray<double>.GetColumn(ValuesWindFactors, probe);

      pedestrianComfort[probe] = CalcNEN8100Comfort(column);
    }

    return pedestrianComfort;
  }

  
  
  
  private int CalcNEN8100Comfort(double[] annualVelocity)

  {
    // Lets specify the categories from 1-6 which corresponds to A-S
    // https://clqtg10snjb14i85u49wifbv-wpengine.netdna-ssl.com/wp-content/uploads/2019/11/Davenport.png

    double year = 8760;
         

    int pedestrianComfort = 0;

    // start from the highest and start binning

    if (annualVelocity.Where(num => num > 15).Count() >= 0.05 * 0.01*year)
    {
      pedestrianComfort = 6;
      return pedestrianComfort;
    }
    else if (annualVelocity.Where(num => num > 5).Count() >= 20 * 0.01*year)
    {
      pedestrianComfort = 5;
      return pedestrianComfort;
    }
    else if (annualVelocity.Where(num => num > 5).Count() < 20 * 0.01*year && annualVelocity.Where(num => num > 5).Count() > 10 * 0.01*year)
    {
      pedestrianComfort = 4;
      return pedestrianComfort;
    }
    else if (annualVelocity.Where(num => num > 5).Count() < 10 * 0.01*year && annualVelocity.Where(num => num > 5).Count() > 5 * 0.01*year)
    {
      pedestrianComfort = 3;
      return pedestrianComfort;
    }
    else if (annualVelocity.Where(num => num > 5).Count() < 5 * 0.01*year && annualVelocity.Where(num => num > 5).Count() > 2.5 * 0.01*year)
    {
      pedestrianComfort = 2;
      return pedestrianComfort;
    }
    else // (annualVelocity.Where(num => num > 3.6).Count() < onefive)
    {
      pedestrianComfort = 1;
      return pedestrianComfort;
    }
  }
# ---------- end c_script ----------
panel_4 = Panel(c_script.A)
graph = QuickGraph(c_script.A, SortOrder=0)
panel_5 = Panel(windfactors_3.DavenportPedestrianComfort)

# ==== cluster MeshPlane
number = ClusterInput()
number_2 = Number(number)
settings_custom = SettingsCustom(
    StitchSeams=True,
    SimplePlanes=False,
    Refine=True,
    MinCount=16,
    MaxCount=400,
    AspectRatio=20,
    MaxDistance=0,
    MaxAngle=20,
    MinEdge=number_2,
    MaxEdge=number_2)
brep = ClusterInput()
mesh_brep = MeshBrep(Brep=brep, Settings=settings_custom)
deconstruct_mesh = DeconstructMesh(Mesh=mesh_brep)  # -> Vertices, Faces, Colours, Normals
faces = ClusterOutput(deconstruct_mesh.Faces)
vertices = ClusterOutput(deconstruct_mesh.Vertices)

# ==== cluster Cluster
data = ClusterInput()
data_2 = Data(data)
data_3 = ClusterOutput(data_2)
bnd = Bounds(Numbers=data_2)
dedomain = DeconstructDomain(Domain=bnd)  # -> Start, End
S = ClusterOutput(dedomain.Start)
E = ClusterOutput(dedomain.End)

# ==== cluster Cluster_2
C = ClusterInput()
circle = CircleCNR(Center=C, Normal=Vector(0, 0, 1), Radius=2)
srf = Surface(circle)
srf_2 = ClusterOutput(srf)
